# Grasshopper definition Vase1.gh (Grasshopper 1.0.4)

# ----
# basic star
number_slider = Slider(2, range=0..10)
number_slider_2 = Slider(20, range=0..30)
xy = XYPlane(Origin=Point(0, 0, 0))
multiplication = Multiplication(A=number_slider_2, B=number_slider)
pi = Pi(Factor=number_slider)
# Basic Star Figure
polygon = Polygon(Plane=xy, Radius=Slider(45, range=0..1000), Segments=number_slider_2, FilletRadius=0)  # -> Polygon, Length
polygon_2 = Polygon(Plane=xy, Radius=Slider(60, range=0..1000), Segments=number_slider_2, FilletRadius=0)  # -> Polygon, Length
division = Division(A=pi, B=multiplication)
rotate = Rotate(Geometry=polygon_2.Polygon, Angle=division, Plane=PlaneXY(0, 0, 0))  # -> Geometry, Transform
explode = Explode(Curve=polygon.Polygon, Recursive=True)  # -> Segments, Vertices
explode_2 = Explode(Curve=rotate.Geometry, Recursive=True)  # -> Segments, Vertices
shift = ShiftList(List=explode.Vertices, Shift=1, Wrap=False)
shift_2 = ShiftList(List=explode_2.Vertices, Shift=1, Wrap=False)
weave = Weave(Pattern=[0, 1], Stream0=shift, Stream1=shift_2, NullGaps=False)
pline = PolyLine(Vertices=weave, Closed=True)

number_slider_3 = Slider(5, range=0..10)
range = Range(Domain=Slider(200, range=0..1000), Steps=number_slider_3)
Z = UnitZ(Factor=range)
# Move and Scale
range_2 = Range(Domain=Domain(0, 1), Steps=number_slider_3)
move = Move(Geometry=pline, Motion=Z)  # -> Geometry, Transform
graph = GraphMapper(
    range_2,
    x0=0,
    x1=1,
    y0=0,
    y1=1,
    container_name="Bezier",
    cpx=[0, 0.5975388885, 1, 1],
    cpy=[0.4464971423, 0.7471157312, 0.8341518044, 0.4448795915])
pcen = PolygonCenter(Polyline=move.Geometry)  # -> CenterV, CenterE, CenterA
pdecon = Deconstruct(Point=pcen.CenterV)  # -> XComponent, YComponent, ZComponent
pt = ConstructPoint(XCoordinate=0, YCoordinate=0, ZCoordinate=pdecon.ZComponent)
multiplication_2 = Multiplication(A=graph, B=Slider(1.458, range=1..3))
scale_nu = ScaleNU(Geometry=move.Geometry, Plane=pt, ScaleX=multiplication_2, ScaleY=multiplication_2, ScaleZ=1)  # -> Geometry, Transform

# ----
# Rotate Pattern2
pi_2 = Pi(Factor=Slider(0.73, range=0..4))
range_3 = Range(Domain=pi_2, Steps=number_slider_3)
rotate_2 = Rotate(Geometry=scale_nu.Geometry, Angle=range_3, Plane=PlaneXY(0, 0, 0))  # -> Geometry, Transform
loft = Loft(
    Curves=rotate_2.Geometry,
    Options={Adjust=False, Closed=False, LoftEnds=0, LoftSimp=0, LoftType=0, Rebuild=10, Refit=0.01})

lng = ListLength(List=scale_nu.Geometry)
# Rotate pattern 1
series = Series(Start=0, Step=Slider(0.594, range=0..2), Count=lng)
sin = Sine(Value=series)
rotate_3 = Rotate(Geometry=scale_nu.Geometry, Angle=sin, Plane=PlaneXY(0, 0, 0))  # -> Geometry, Transform
loft_2 = Loft(
    Curves=rotate_3.Geometry,
    Options={Adjust=False, Closed=False, LoftEnds=0, LoftSimp=0, LoftType=0, Rebuild=10, Refit=0.01})
